# Dynamo graph Auto_ViewTemp_Apply.dyn (Dynamo 2.6.1.8786)
# packages: Modelical 2021.12.15

categories = Categories("OST_Views")
all_elements_of_category = ElementsOfCategory(Category=categories)
string = StringInput("View Name")
getParameterValueByName = Element.GetParameterValueByName(element=all_elements_of_category, parameterName=string)
string_from_object = FromObject(obj=getParameterValueByName)
string_2 = StringInput("Conduit Plan")
contains = String.Contains(str=string_from_object, searchFor=string_2)
filterByBoolMask = List.FilterByBoolMask(list=all_elements_of_category, mask=contains)
string_3 = StringInput("3D-ISO")
applyViewTemplate = Custom[ApplyViewTemplate](view=filterByBoolMask.in, tempNames=string_3)  # package Modelical; Apply ViewTemplate(s) to selected view(s).
